# Grasshopper definition FrameTemplate.gh (Grasshopper 1.0.5)
# plug-ins: AxisVM

nb_of_frames_in_x_dir = Slider(3, range=0..16)
nb_of_frames_in_y_dir = Slider(4, range=0..16)
nb_of_levels = Slider(5, range=0..16)
height_of_level = Slider(3, range=0..10)
# Parameters
span_x = Slider(20, range=0..200)
span_y = Slider(20, range=0..200)
bottom_left_corner = Point(Point(0, 0, 0))

division = Division(A=span_y, B=nb_of_frames_in_y_dir)
# Geometry
division_2 = Division(A=span_x, B=nb_of_frames_in_x_dir)
series = Series(Start=height_of_level, Step=height_of_level, Count=expr("x-1", nb_of_levels))
series_2 = Series(Start=0, Step=division_2, Count=nb_of_frames_in_x_dir)
series_3 = Series(Start=0, Step=division, Count=nb_of_frames_in_y_dir)
series_4 = Series(Start=0, Step=height_of_level, Count=nb_of_levels)
X = UnitX(Factor=series_2)
Y = UnitY(Factor=series_3)
Z = UnitZ(Factor=series_4)
Z_2 = UnitZ(Factor=series)
move = Move(Geometry=bottom_left_corner, Motion=X)  # -> Geometry, Transform
move_2 = Move(Geometry=graft(move.Geometry), Motion=Y)  # -> Geometry, Transform
flip = FlipMatrix(Data=move_2.Geometry)
shift = ShiftList(List=reverse(move_2.Geometry), Shift=1, Wrap=False)  # -> reverse(List)
shift_2 = ShiftList(List=reverse(flip), Shift=1, Wrap=False)  # -> reverse(List)
move_3 = Move(Geometry=graft(move_2.Geometry), Motion=Z)  # -> Geometry, Transform
shift_3 = ShiftList(List=move_2.Geometry, Shift=1, Wrap=False)
shift_4 = ShiftList(List=flip, Shift=1, Wrap=False)
ln = Line(StartPoint=flatten(shift), EndPoint=flatten(shift_3))
ln_2 = Line(StartPoint=flatten(shift_2), EndPoint=flatten(shift_4))
shift_5 = ShiftList(List=reverse(move_3.Geometry), Shift=1, Wrap=False)  # -> reverse(List)
shift_6 = ShiftList(List=move_3.Geometry, Shift=1, Wrap=False)
move_4 = Move(Geometry=graft(ln), Motion=Z_2)  # -> Geometry, Transform
move_5 = Move(Geometry=graft(ln_2), Motion=Z_2)  # -> Geometry, Transform
ln_3 = Line(StartPoint=flatten(shift_5), EndPoint=flatten(shift_6))
beam_x = Line(move_4.Geometry)
beam_y = Line(move_5.Geometry)
columns = Line(ln_3)

x_m = Panel(division_2)
y_m = Panel(division)

# ----
# Create AxMembers
line = Line(flatten(beam_x))
axmembers = AxMembersAxisVM(Line=line, Name="Beam X", Mat="S 235", CrossSection="IPE 300", Type="beam")

line_2 = Line(flatten(beam_y))
axmembers_2 = AxMembersAxisVM(Line=line_2, Name="Beam Y", Mat="S 235", CrossSection="IPE 360", Type="beam")

line_3 = Line(flatten(columns))
axmembers_3 = AxMembersAxisVM(Line=line_3, Name="Columns", Mat="S 235", CrossSection="HE  340 M", Type="beam")

panel = Panel([axmembers, axmembers_2, axmembers_3])
# Export to AxisVM
membtoaxisvm = SendMembersToAxisVM(AxisVMMember=flatten([axmembers, axmembers_2, axmembers_3]))
