# Grasshopper definition OverviewExamples.gh (Grasshopper 1.0.5)
# plug-ins: AxisVM, Kangaroo2 Components

lenght_of_line_m = Slider(5, range=3..10)

# ----
# Ex. 2: Export the centerlines of a gridshell to AxisVM
# This example demonstrates how to send multiple line elements to AxisVM. As an example a grid shell structure is created. The centerlines of this structure is then plugged in to the LnToAxisVM component.
# Input
H = Slider(3, range=0..100)
L = Slider(20, range=0..100)
number_slider = Slider(6, range=0..100)

lenght_of_line_m_2 = Slider(4, range=3..10)
# Ex. 1: Export a line to AxisVM
# This example shows how to send a line element to AxisVM. Simply create a line, and then plug it in to LnToAxisVM component.
point_at_base = Point(Point(-1, 0, 0))
# Ex. 3: Create and export a structural element to AxisVM
# This example shows how create a structural member with the AxMember component.  The created member is then plugged in to the MembToAxisVM component, that will export this element to AxisVM.
point_at_base_2 = Point(Point(-2, 0, 0))

# ----
# Point grid
division = Division(A=L, B=number_slider)
series = Series(Start=expr("-x/2", L), Step=division, Count=expr("x+1", number_slider))  # -> graft(Series)
series_2 = Series(Start=expr("-x/2", L), Step=division, Count=expr("x+1", number_slider))
pt = ConstructPoint(XCoordinate=expr("x/2", L), YCoordinate=expr("x/2", L), ZCoordinate=0)
eval = Evaluate(F="H*((1-(x/(z/2))^2)*(1-(y/(z/2))^2))", x=graft(series), y=series_2, z=L, H=H)
pt_2 = ConstructPoint(XCoordinate=graft(series), YCoordinate=series_2, ZCoordinate=eval)
move = Move(Geometry=pt_2, Motion=pt)  # -> Geometry, Transform

Z = UnitZ(Factor=lenght_of_line_m)
Z_2 = UnitZ(Factor=lenght_of_line_m_2)
move_2 = Move(Geometry=point_at_base, Motion=Z)  # -> Geometry, Transform
move_3 = Move(Geometry=point_at_base_2, Motion=Z_2)  # -> Geometry, Transform
point_at_top = Point(move_2.Geometry)
point_at_top_2 = Point(move_3.Geometry)

# ----
# line element as input data
ln = Line(StartPoint=point_at_base_2, EndPoint=point_at_top_2)  # -> graft(Line)

# ----
# line element as input data
# Any number of lines can be defined.
# The geometric data is always interpreted
# in meters (lenght of line, node positions.)
# Zero lenght lines will be omitted.
# Do not use curves.
# If lines are grafted, it will not create multiple AxisVM models.
ln_2 = Line(StartPoint=point_at_base, EndPoint=point_at_top)

# ----
# Grid of lines
dispatch = Dispatch(List=move.Geometry, DispatchPattern=[True, False])  # -> ListA, ListB
dispatch_2 = Dispatch(List=move.Geometry, DispatchPattern=[True, False])  # -> ListA, ListB
flip = FlipMatrix(Data=dispatch.ListA)
flip_2 = FlipMatrix(Data=dispatch_2.ListA)
dispatch_3 = Dispatch(List=flip, DispatchPattern=[True, False])  # -> ListA, ListB
dispatch_4 = Dispatch(List=flip_2, DispatchPattern=[True, False])  # -> simplify(ListA), ListB
flip_3 = FlipMatrix(Data=dispatch_3.ListA)
shift = ShiftList(List=dispatch_4.ListA, Shift=1, Wrap=False)
shift_2 = ShiftList(List=flip_3, Shift=1, Wrap=False)
ln_3 = Line(StartPoint=flip_3, EndPoint=shift_2)
ln_4 = Line(StartPoint=dispatch_4.ListA, EndPoint=shift)

# ----
# AxisVM component
# double-click on component
# for sending lines to AxisVM
lntoaxisvm = SendLinesToAxisVM(Line=flatten(ln_2))

# ----
# Diagonals
flip_4 = FlipMatrix(Data=dispatch_4.ListA)
split = SplitList(List=dispatch_4.ListA, Index=expr("x/2", number_slider))  # -> ListA, ListB
flip_5 = FlipMatrix(Data=dispatch_4.ListA)
split_2 = SplitList(List=reverse(dispatch_4.ListA), Index=expr("x/2", number_slider))  # -> reverse(ListA), ListB
flip_6 = FlipMatrix(Data=dispatch.ListB)
split_3 = SplitList(List=reverse(flip_4), Index=expr("x/2", number_slider))  # -> reverse(ListA), ListB
split_4 = SplitList(List=reverse(flip_5), Index=expr("x/2", number_slider))  # -> reverse(ListA), ListB
dispatch_5 = Dispatch(List=flip_6, DispatchPattern=[True, False])  # -> ListA, ListB
flip_7 = FlipMatrix(Data=split.ListA)
flip_8 = FlipMatrix(Data=split_2.ListA)
split_5 = SplitList(List=flip_7, Index=expr("x/2", number_slider))  # -> ListA, ListB
split_6 = SplitList(List=flip_8, Index=expr("x/2", number_slider))  # -> ListA, ListB
flip_9 = FlipMatrix(Data=split_4.ListA)
flip_10 = FlipMatrix(Data=split_3.ListA)
pt_3 = Point(dispatch_5.ListB)
split_7 = SplitList(List=reverse(flip_10), Index=expr("x/2", number_slider))  # -> reverse(ListA), ListB
split_8 = SplitList(List=flip_9, Index=expr("x/2", number_slider))  # -> ListA, ListB
flip_11 = FlipMatrix(Data=split_6.ListA)
flip_12 = FlipMatrix(Data=split_5.ListA)
ln_5 = Line(StartPoint=flip_12, EndPoint=pt_3)
ln_6 = Line(StartPoint=flip_11, EndPoint=pt_3)
ln_7 = Line(StartPoint=split_8.ListA, EndPoint=pt_3)
ln_8 = Line(StartPoint=split_7.ListA, EndPoint=pt_3)

# ----
# Elements in x direction
flip_13 = FlipMatrix(Data=ln_4)
item = ListItem(List=reverse(flip_13), Index=0, Wrap=True)
item_2 = ListItem(List=flip_13, Index=0, Wrap=True)

# ----
# Other input parameters as strings
# give any name for the structural element or group (visible in Grasshopper only)
# define material using the exact same string as that in AxisVM material library
# define cross-section using the exact same string as that in AxisVM cross-section library
# choose element type: truss, beam, rib
# Limitations
#  - material type only according to Eurocode
#  - available section types:
#        I
#        hollow sections (pipe, box)
#        solid (rectangular, round)
panel = Panel("cols")

line = Line(flatten(ln))

# ----
# AxisVM component
axmembers = AxMembersAxisVM(Line=line, Name=panel, Mat="C12/15", CrossSection="20x20", Type="beam")

# ----
# Elements in y direction
pt_4 = Point(pt_3)
pt_5 = Point(dispatch_3.ListB)
flip_14 = FlipMatrix(Data=pt_4)
flip_15 = FlipMatrix(Data=pt_5)
item_3 = ListItem(List=reverse(flip_15), Index=0, Wrap=True)
item_4 = ListItem(List=flip_15, Index=0, Wrap=True)
merge = Merge(Data1=item_4, Data2=flip_14, Data3=item_3)
sort_pt = SortPoints(Points=simplify(merge))  # -> Points, Indices
shift_3 = ShiftList(List=sort_pt.Points, Shift=1, Wrap=False)
ln_9 = Line(StartPoint=sort_pt.Points, EndPoint=shift_3)

panel_2 = Panel(axmembers)

flip_16 = FlipMatrix(Data=ln_3)
dispatch_6 = Dispatch(List=flip_16, DispatchPattern=[True, False, False, True])  # -> ListA, ListB
line_2 = Line(dispatch_6.ListA)
line_3 = Line(dispatch_6.ListB)

# ----
# AxisVM component
# double-click on component
# for sending members to AxisVM
# 
# it's best to flatten input data
membtoaxisvm = SendMembersToAxisVM(AxisVMMember=flatten(axmembers))

# ----
# Create gridshell geometry
diagonals = Line([ln_5, ln_6, ln_7, ln_8])
boundary = Line([item_2, item, line_2])
ydir = Line([ln_9, line_3])

# ----
# Ex. 5: Create and export a gridshell to AxisVM (various section sizes)
# This example demonstrates how to define structural members with various parameters and then export them to AxisVM.
# Diagonal elements
line_4 = Line(flatten(diagonals))
axmembers_2 = AxMembersAxisVM(Line=line_4, Name="diag", Mat="S 235", CrossSection="ROR  219,10*   6,3", Type="beam")

# ----
# Elements in y direction
line_5 = Line(flatten(ydir))
axmembers_3 = AxMembersAxisVM(Line=line_5, Name="yDir", Mat="S 235", CrossSection="ROR  219,10*   4,5", Type="truss")

# ----
# Boundary elements
line_6 = Line(flatten(boundary))
axmembers_4 = AxMembersAxisVM(Line=line_6, Name="boundary", Mat="S 355", CrossSection="400X300X16,0", Type="rib")

panel_3 = Panel([axmembers_2, axmembers_3, axmembers_4])

# ----
# AxisVM component
# double-click on component
# for sending members to AxisVM
# 
# it's best to flatten input data
membtoaxisvm_2 = SendMembersToAxisVM(AxisVMMember=flatten([axmembers_2, axmembers_3, axmembers_4]))

line_7 = Line(flatten([ln_9, ln_5, ln_6, ln_7, ln_8, item_2, item, ln_3]))

# ----
# Edit line list:
# delete zero length lines
# and duplicates
dupln = RemoveDuplicateLines(Lines=line_7, Tolerance=0.01)
len = Length(Curve=dupln)
smaller = SmallerThan(FirstNumber=len, SecondNumber=0.1)  # -> SmallerThan, OrEqualTo
dispatch_7 = Dispatch(List=dupln, DispatchPattern=smaller.SmallerThan)  # -> ListA, ListB

line_8 = Line(dispatch_7.ListB)

# ----
# Ex. 4: Create and export a gridshell to AxisVM
# This example demonstrates how to send multiple structural elements of a grid shell to AxisVM.
# line elements as input data
line_9 = Line(flatten(line_8))

axmembers_5 = AxMembersAxisVM(Line=line_9, Name="grid", Mat="S 235", CrossSection="IPE 200", Type="beam")
panel_4 = Panel(axmembers_5)

# ----
# AxisVM component
# double-click on component
# for sending members to AxisVM
# 
# it's best to flatten input data
# do not input duplicate AxMembers, as it will
# create two structural members at the same position
membtoaxisvm_3 = SendMembersToAxisVM(AxisVMMember=flatten(axmembers_5))

# ----
# AxisVM component
# double-click on component
# for sending lines to AxisVM
# 
# it's best to flatten input data
lntoaxisvm_2 = SendLinesToAxisVM(Line=flatten(line_8))
