# Grasshopper definition TrussTemplate.gh (Grasshopper 1.0.5)
# plug-ins: AxisVM, Kangaroo2 Components

height_at_ends = Slider(3, range=0..10)
number_to_divide_chord_with_even_nb = Slider(6, range=0..16)
height_at_apex = Slider(5, range=0..10)
# Parameters
span = Slider(20, range=0..30)
bottom_left_corner = Point(Point(0, 0, 0))

expression = Expression(x=height_at_ends, y=height_at_apex, z=number_to_divide_chord_with_even_nb, Expression="(y-x)*2/z")
# Points
division = Division(A=span, B=number_to_divide_chord_with_even_nb)
series = Series(Start=expr("x/2", division), Step=division, Count=number_to_divide_chord_with_even_nb)
series_2 = Series(Start=0, Step=division, Count=expr("x+1", number_to_divide_chord_with_even_nb))
series_3 = Series(Start=height_at_ends, Step=expression, Count=expr("x/2", number_to_divide_chord_with_even_nb))
merge = Merge(Data1=flatten(series_3), Data2=flatten(height_at_apex), Data3=reverse(flatten(series_3)))
X = UnitX(Factor=series_2)
merge_2 = Merge(Data1=0, Data2=flatten(series), Data3=span)
move = Move(Geometry=bottom_left_corner, Motion=X)  # -> Geometry, Transform
X_2 = UnitX(Factor=merge_2)
Z = UnitZ(Factor=merge)
move_2 = Move(Geometry=bottom_left_corner, Motion=X_2)  # -> Geometry, Transform
move_3 = Move(Geometry=move.Geometry, Motion=Z)  # -> Geometry, Transform

# ----
# Lines
shift = ShiftList(List=move_2.Geometry, Shift=1, Wrap=False)
shift_2 = ShiftList(List=move_3.Geometry, Shift=1, Wrap=False)
ln = Line(StartPoint=move_2.Geometry, EndPoint=move_3.Geometry)
ln_2 = Line(StartPoint=shift, EndPoint=move_3.Geometry)
ln_3 = Line(StartPoint=move_2.Geometry, EndPoint=shift)
ln_4 = Line(StartPoint=move_3.Geometry, EndPoint=shift_2)
len = Length(Curve=ln_3)
len_2 = Length(Curve=ln)
len_3 = Length(Curve=ln_2)
len_4 = Length(Curve=ln_4)
equals = Equality(FirstNumber=len_2, SecondNumber=0)  # -> Equality, Inequality
equals_2 = Equality(FirstNumber=len_4, SecondNumber=0)  # -> Equality, Inequality
equals_3 = Equality(FirstNumber=len_3, SecondNumber=0)  # -> Equality, Inequality
equals_4 = Equality(FirstNumber=len, SecondNumber=0)  # -> Equality, Inequality
dispatch = Dispatch(List=ln_3, DispatchPattern=equals_4.Inequality)  # -> ListA, ListB
dispatch_2 = Dispatch(List=ln, DispatchPattern=equals.Inequality)  # -> ListA, ListB
dispatch_3 = Dispatch(List=ln_2, DispatchPattern=equals_3.Inequality)  # -> ListA, ListB
dispatch_4 = Dispatch(List=ln_4, DispatchPattern=equals_2.Inequality)  # -> ListA, ListB
dupln = RemoveDuplicateLines(Lines=[dispatch_3.ListA, dispatch_2.ListA], Tolerance=0.01)

X_3 = UnitX(Factor=1)
line = Line(flatten([dispatch.ListA, dupln, dispatch_4.ListA]))
angle = Angle(VectorA=dupln, VectorB=X_3)  # -> Angle, Reflex
len_5 = Length(Curve=line)
deg = Degrees(Radians=angle.Angle)
sort = SortList(Keys=len_5)  # -> Keys, ValuesA
sort_2 = SortList(Keys=deg)  # -> Keys, ValuesA
lenghts = Panel(sort.Keys)
truss_angles = Panel(sort_2.Keys)

# ----
# Create AxMembers
line_2 = Line(flatten(dispatch.ListA))
axmembers = AxMembersAxisVM(Line=line_2, Name="upper chord", Mat="S 235", CrossSection="IPE 200", Type="beam")

line_3 = Line(flatten(dupln))
axmembers_2 = AxMembersAxisVM(Line=line_3, Name="trusses", Mat="S 235", CrossSection="80X 40X 5,0", Type="truss")

line_4 = Line(flatten(dispatch_4.ListA))
axmembers_3 = AxMembersAxisVM(Line=line_4, Name="lower chord", Mat="S 235", CrossSection="IPE 240", Type="beam")

panel = Panel([axmembers, axmembers_2, axmembers_3])
# Export to AxisVM
membtoaxisvm = SendMembersToAxisVM(AxisVMMember=flatten([axmembers, axmembers_2, axmembers_3]))
